# Grasshopper definition XML Split.gh (Grasshopper 0.9.76)
# plug-ins: Python Interpreter, Anemone

python = PythonScript()  # -> a; disabled
# ---------- python: Python ----------
import Grasshopper as gh
import Rhino
import rhinoscriptsyntax as rs


GH = str(ghenv.Component.Attributes.Owner.OnPingDocument().FilePath)
a = GH
# ---------- end python ----------
file = ReadFile(F=python, PerLineParse=False)  # -> C; disabled
#   port F: Uri of file to read
# ---------- file: VB line parser ----------
    action = GH_LineParserAction.Include
    Return line

    'Parse the line and return some data that represents the line.
    'If the line cannot be parsed, you can return Nothing and
    'assign a different action.
    'The default implementation is to just return the line itself.
    'If you return types that implement IGH_Goo, this component
    'will work substantially faster.
# ---------- end file ----------
path = FilePath("C:\Users\s-abutler\Downloads\RPG\xml\Stranger+Collective+Wiki-20160210125835.xml")
python_2 = PythonScript(log=file)  # disabled
# ---------- python_2: Python ----------
import Grasshopper as gh
import Rhino
import rhinoscriptsyntax as rs
import scriptcontext as sc
import getpass
import datetime
if log:
    User = str(getpass.getuser())
    GHS = str(ghenv.Component.Attributes.Owner.OnPingDocument().FilePath)
    Description = str(ghenv.Component.Attributes.Owner.OnPingDocument().Properties.Description)
    Author = str(gh.CentralSettings.AuthorName)
    dateCreated = str(ghenv.Component.Attributes.Owner.OnPingDocument().Properties.Date)
    Revision = str(ghenv.Component.Attributes.Owner.OnPingDocument().Properties.Revisions.Count)
    Version = str(gh.Versioning.Version)
    GHL = GHS.split("\\")
    del GHL[-1]
    GHL = "\\".join(GHL)
    sc.doc = Rhino.RhinoDoc.ActiveDoc
    RhinoS = rs.DocumentPath()
    RHL = RhinoS.split("\\")
    del RHL[-1]
    RHL = "\\".join(RHL)
    
    
    timeNow = str(datetime.datetime.now())
    log = timeNow + '\t' + User + '\t' + RhinoS + '\t' + GHS + '\t' + Description + '\t' + Author + '\t' + Revision + '\t' + Version + '\r\n'
    open(GHL + '\\log.log', 'a').close()
    with open(GHL + '\\log.log', 'ab') as myfile:
        myfile.write(log)
    open(RHL + '\\log.log', 'a').close()
    with open(RHL + '\\log.log', 'ab') as myfile:
        myfile.write(log)
# ---------- end python_2 ----------
path_2 = FilePath(["C:\Users\s-abutler\Downloads\RPG\txt\Advantage_ 3D Spatial Sense.txt", "C:\Users\s-abutler\Downloads\RPG\txt\Advantage_ 360° Vision.txt", "C:\Users\s-abutler\Downloads\RPG\txt\Advantage_ Absolute Direction.txt", "C:\Users\s-abutler\Downloads\RPG\txt\Advantage_ Absolute Timing.txt", "C:\Users\s-abutler\Downloads\RPG\txt\Advantage_ Accessory.txt", "C:\Users\s-abutler\Downloads\RPG\txt\Advantage_ Acute Hearing.txt"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])
file_2 = ReadFile(File=path, PerLineParse=True)
item = ListItem(List=path_2, Index=1, Wrap=True)
rep = ReplaceText(Text="<page>", Find="<", Replace="</", RecursiveReplace=False)
toggle = BooleanToggle(True)
tmatch = MatchText(Text=file_2, RegEx="<page>", Case=True)
tmatch_2 = MatchText(Text=file_2, RegEx=rep, Case=True)
file_3 = ReadFile(File=item, PerLineParse=True)
join = TextJoin(Text=file_3)
mindex = MemberIndex(Set=tmatch, Member=toggle)  # -> Index, Count
mindex_2 = MemberIndex(Set=tmatch_2, Member=toggle)  # -> Index, Count
tmatch_3 = MatchText(Text=join, RegEx="REDIRECT", Case=True)
dom = ConstructDomain(DomainStart=mindex.Index, DomainEnd=mindex_2.Index)
dispatch = Dispatch(List=file_3, DispatchPattern=tmatch_3)  # -> ListA, ListB
subset = SubList(List=file_2, Domain=dom, Wrap=True)  # -> simplify(List), Index
data = Data(dispatch.ListA)
branch = TreeBranch(Tree=subset.List, Path=["{3}", "{10}", "{20}"], MaintainPaths=True)
item_2 = ListItem(List=data, Index=0, Wrap=True)  # -> Item, Item1
split = TextSplit(Text=item_2.Item1, Separators="[")
cluster = Cluster(data=subset.List, data_2="<title")
cluster_2 = Cluster(data=subset.List, data_2="<text")
item_3 = ListItem(List=reverse(split), Index=0, Wrap=True)
split_2 = TextSplit(Text=item_3, Separators="]")
subset_2 = SubList(List=subset.List, Domain=cluster, Wrap=True)  # -> List, Index
subset_3 = SubList(List=subset.List, Domain=cluster_2, Wrap=True)  # -> List, Index
item_4 = ListItem(List=split_2, Index=0, Wrap=True)
rep_2 = ReplaceText(Text=item_4, Find=": ", Replace="_", RecursiveReplace=False)
rep_3 = ReplaceText(Text=subset_2.List, Find="<", Replace="█", RecursiveReplace=False)
panel = Panel("C:\Users\s-abutler\Downloads\RPG\txt\█.txt")
join_2 = TextJoin(Text=subset_3.List)
rep_4 = ReplaceText(Text=join_2, Find="<", Replace="█", RecursiveReplace=False)
rep_5 = ReplaceText(Text=rep_3, Find=">", Replace="█", RecursiveReplace=False)
rep_6 = ReplaceText(Text=rep_4, Find=">", Replace="█", RecursiveReplace=False)
rep_7 = ReplaceText(Text="redirect: \"█\"", Find="█", Replace=rep_2, RecursiveReplace=False)
rep_8 = ReplaceText(Text="title: \"█\",", Find="█", Replace=item_2.Item, RecursiveReplace=False)
split_3 = TextSplit(Text=rep_5, Separators="█")
split_4 = TextSplit(Text=rep_6, Separators="█")
merge = Merge(Data1=flatten(rep_8), Data2=flatten(rep_7))
item_5 = ListItem(List=split_3, Index=2, Wrap=True)
item_6 = ListItem(List=split_4, Index=2, Wrap=True)  # -> flatten(Item)
panel_2 = Panel("|style=&quot;height:40px; text-align:left;&quot;| &lt;font size=&quot;4&quot;&gt;")
item_7 = ListItem(List=dispatch.ListB, Index=0, Wrap=True)
cull_i = CullIndex(List=dispatch.ListB, Indices=0, Wrap=True)
rep_9 = ReplaceText(Text=cull_i, Find="{{Advantage Template}}", RecursiveReplace=False)
merge_2 = Merge(Data1="{", Data2=merge, Data3="}")
rep_10 = ReplaceText(Text=item_5, Find=":", Replace="_", RecursiveReplace=False)  # -> flatten(Result)
merge_3 = Merge(Data1=simplify(item_5), Data2=simplify(graft(item_6)))
rep_11 = ReplaceText(Text=rep_9, Find=panel_2, Replace="<td class=\"title\">", RecursiveReplace=False)
rep_12 = ReplaceText(Text=item_2.Item, Find=" ", RecursiveReplace=False)
lng = ListLength(List=rep_10)
join_3 = TextJoin(Text=merge_2)
int = Integer(-1)
# |style=&quot;height:40px; text-align:left;&quot;| &lt;font size=&quot;4&quot;&gt;{{Indent}}'''360° VISION'''&lt;/font&gt;
# |-
# | style=&quot;text-align:right;&quot; | &lt;font size=&quot;3&quot;&gt;''25 points''&lt;/font&gt;
# |-
# |{{Indent}}You have a 360° field of vision. You have no penalty to defend against attacks from the sides or rear. You can attack foes to your sides or rear without making a Wild Swing, but you are at -2 to hit due to the clumsy angle of attack (note that some Karate techniques do not suffer this penalty). Finally, you are at +5 to detect Shadowing attempts, and are never surprised by a danger that comes from behind, unless it also is concealed from sight.
# 
# {{Indent}}Extra eyes are merely a special effect of this trait - you can have any number of eyes, but the point cost remains the same.
# 
# {{Indent}}
# ----
# 
# &lt;font size=&quot;3&quot;&gt;'''Special Enhancements'''&lt;/font&gt;
# 
# {{Indent}}Panoptic 1: You can see all around you without turning your head and without the need for extra eyes. This is an enhancement because your gift isn't obvious - you can visibly stare in one direction and actually be looking in another! You still need eyes, though. If you're blindfolded, dazzled, blinded by injuries, etc., you cannot see. +20%.
# 
# {{Indent}}Panoptic 2: As above, but you don't need eyes. You can always perceive everything going on around you, even if blinded or blindfolded. You still need light, unless you have something like Dark Vision. Blows to the eyes injure you normally but won't blind this sense. +60%.
# 
# {{Indent}}
# ----
# 
# &lt;font size=&quot;3&quot;&gt;'''Special Limitations'''&lt;/font&gt;
# 
# {{Indent}}Easy to Hit: Your eyes are on stalks, unusually large, or otherwise more vulnerable to attack. Others can target your eyes from within their arc of vision at only -6 to hit. -20%.
# |}
join_4 = TextJoin(Text=merge_3)  # -> flatten(Result)
rep_13 = ReplaceText(Text=rep_11, Find="{{Indent}}", RecursiveReplace=False)
panel_3 = Panel("| style=&quot;text-align:right;&quot; | &lt;font size=&quot;3&quot;&gt;''")
series = Series(Start=1, Step=1, Count=lng)
rep_14 = ReplaceText(Text=rep_12, Find=":", Replace="_", RecursiveReplace=False)
loop_start = LoopStart(Repeat=0, Data_0=int)  # -> port, Counter, Data_0
null = NullItem(Item=item_2.Item)  # -> NullFlags, InvalidFlags, Description
rep_15 = ReplaceText(Text=rep_13, Find="'''", RecursiveReplace=False)
int_2 = Integer(series)
expression = Expression(x=loop_start.Data_0, Expression="x+1")
bool = Boolean(invert(null.NullFlags))
rep_16 = ReplaceText(Text=rep_15, Find="&lt;/font&gt;", Replace="</td>", RecursiveReplace=False)
rep_17 = ReplaceText(Text=rep_16, Find="|-", Replace="</tr><tr>", RecursiveReplace=False)
rep_18 = ReplaceText(Text=rep_17, Find=panel_3, Replace="<td class=\"points\">", RecursiveReplace=False)
rep_19 = ReplaceText(Text=rep_18, Find="''", RecursiveReplace=False)
rep_20 = ReplaceText(Text="C:\Users\s-abutler\Downloads\RPG\txt\█.json", Find="█", Replace=rep_14, RecursiveReplace=False)  # -> flatten(Result)
loop_end = LoopEnd(port=loop_start.port, Exit=False, Data_0=expression, pausedState=False, state="Constant output")
rep_21 = ReplaceText(Text=panel, Find="█", Replace=int_2, RecursiveReplace=False)  # -> flatten(Result)
lng_2 = ListLength(List=rep_21)
rep_22 = ReplaceText(Text=panel, Find="█", Replace=rep_10, RecursiveReplace=False)  # -> flatten(Result)
item_8 = ListItem(List=rep_21, Index=loop_end, Wrap=False)
save = SaveToFile(D=join_3, B=bool, L=rep_20)
# ---------- save: VB ----------
    If B = True Then
      system.IO.File.WriteAllText(L, D)
    End If
# ---------- end save ----------
item_9 = ListItem(List=join_4, Index=loop_end, Wrap=False)
save_2 = SaveToFile(D=graft(join_4), B=Toggle(False), L=graft(rep_22))  # same code as save
panel_4 = Panel(rep_19)

# ==== cluster Cluster
data = ClusterInput()
data_2 = ClusterInput()
data_3 = Data(data)
data_4 = Data(data_2)
rep = ReplaceText(Text=data_4, Find="<", Replace="</", RecursiveReplace=False)
toggle = BooleanToggle(True)
tmatch = MatchText(Text=data_3, RegEx=data_4, Case=True)
tmatch_2 = MatchText(Text=data_3, RegEx=rep, Case=True)
mindex = MemberIndex(Set=tmatch, Member=toggle)  # -> Index, Count
mindex_2 = MemberIndex(Set=tmatch_2, Member=toggle)  # -> Index, Count
dom = ConstructDomain(DomainStart=mindex.Index, DomainEnd=mindex_2.Index)
domain = Domain(dom)
domain_2 = ClusterOutput(domain)
